# Grasshopper definition app.gh (Grasshopper 1.0.7)
# plug-ins: Hops

X = Slider(0, range=0..10)
Y = Slider(10, range=0..10)
Z = Slider(9, range=0..10)
concat = Concatenate(FragmentA="http://127.0.0.1:5000", FragmentB="/Point_Cylinder")
hops = Hops(
    _Path=concat,
    XRangeOfRandomness=X,
    YRangeOfRandomness=Y,
    ZRangeOfRandomness=Z,
    RRadius=Slider(2, range=0..10),
    HHeight=Slider(20, range=0..20),
    CacheResultsInMemory=True,
    CacheSolveResults=True,
    RemoteDefinitionLocation="http://127.0.0.1:5000/Point_Cylinder",
    RemoteSolveVersion=(0, 1, 0),
    ShowInput_Enabled=False,
    ShowInput_Path=True,
    SynchronousSolve=True)  # -> RandomPoints, RandomCylinder
geometry = Data(hops.RandomCylinder)
point = Data(hops.RandomPoints)
