# Grasshopper definition app.gh (Grasshopper 1.0.7)
# plug-ins: Hops

number_slider = Slider(4, range=0..6)
concatenate = Concatenate(FragmentA="http://127.0.0.1:5000", FragmentB="/Graph_network")
hops = Hops(
    _Path=concatenate,
    CountX=number_slider,
    CountY=number_slider,
    Layout=Slider(2, range=0..6),
    Radius=Slider(0.06, range=0.01..0.1),
    CacheResultsInMemory=True,
    CacheSolveResults=True,
    RemoteDefinitionLocation="http://127.0.0.1:5000/Graph_network",
    RemoteSolveVersion=(0, 1, 0),
    ShowInput_Enabled=False,
    ShowInput_Path=True,
    SynchronousSolve=True)  # -> Nodes, Edges, SphereStart, SphereEnd, Quantity
